# Dynamo custom node GenGHG_GeometrySYS_2.dyf (Dynamo 2.5.1.7586)
# category: GenGHG
# packages: spring nodes 203.1.0, LunchBox for Dynamo 2018.7.6

geometry = Input(geometry: Autodesk.DesignScript.Geometry.Geometry)
elevation = Input(elevation: double)
translate = Geometry.Translate(geometry=geometry, zTranslation=elevation)
code_block = CodeBlock { 10; }
offset = Curve.Offset(curve=translate, distance=code_block)
byGeometry = BoundingBox.ByGeometry(geom=offset)
ꟿ_boundingbox_2drectangle = Custom[ꟿ BoundingBox.2dRectangle](boundingBox=byGeometry, elevation=elevation)  # package spring nodes; Returns a 2d rectangle from a bounding box
xTranslation = Input(xTranslation: double)
yTranslation = Input(yTranslation: double)
translate_2 = Geometry.Translate(geometry=ꟿ_boundingbox_2drectangle, xTranslation=xTranslation, yTranslation=yTranslation)
geometry_2 = Input(geometry: Autodesk.DesignScript.Geometry.Geometry)
translate_3 = Geometry.Translate(geometry=geometry_2, zTranslation=elevation)
center = Polygon.Center(polygon=translate_3)
translate_4 = Geometry.Translate(geometry=center, xTranslation=xTranslation, yTranslation=yTranslation)
ZAxis = Vector.ZAxis()
degrees = Input(degrees: double)
rotate = Geometry.Rotate(geometry=translate_2, origin=translate_4, axis=ZAxis, degrees=degrees)
Number = Input(Number: double)
divideCurve = Geometry.Curves.DivideCurve(curve=rotate, Number=Number)
Planes = Output(divideCurve.Planes)
Tangents = Output(divideCurve.Tangents)
Parameters = Output(divideCurve.Parameters)
ZAxis_2 = Vector.ZAxis()
rotate_2 = Geometry.Rotate(geometry=translate_3, origin=center, axis=ZAxis_2, degrees=degrees)
center_2 = Polygon.Center(polygon=rotate_2)
code_block_2 = CodeBlock(a=divideCurve.Points) { a; }
uniqueItems = List.UniqueItems(list=code_block_2)
byStartPointEndPoint = Line.ByStartPointEndPoint(startPoint=center_2, endPoint=uniqueItems)
param = Input(param: double)
pointAtParameter = Curve.PointAtParameter(curve=byStartPointEndPoint, param=param)
code_block_3 = CodeBlock { 1; }
chop = List.Chop(list=pointAtParameter, lengths=code_block_3)
lists = Output(chop)
byPoints = Polygon.ByPoints(points=pointAtParameter)
byPatch = Surface.ByPatch(closedCurve=byPoints)
geometry_3 = Input(geometry: Autodesk.DesignScript.Geometry.Geometry)
translate_5 = Geometry.Translate(geometry=geometry_3, zTranslation=elevation)
intersect = Geometry.Intersect(geometry=byPatch, other=translate_5)
deconstructSurface = Geometry.Surfaces.DeconstructSurface(surface=intersect)
Edges = Output(deconstructSurface.Edges)
code_block_4 = CodeBlock { true; }
byPoints_2 = PolyCurve.ByPoints(points=deconstructSurface.Points, connectLastToFirst=code_block_4)
deconstructPolyCurve = Geometry.Curves.DeconstructPolyCurve(polycurve=byPoints_2)
Segments = Output(deconstructPolyCurve.Segments)
b = Input(b: var[]..[])
code_block_5 = CodeBlock(b=b) { b==true; }
flatten = List.Flatten(list=deconstructPolyCurve.Points)
byPoints_3 = Polygon.ByPoints(points=flatten)
center_3 = Polygon.Center(polygon=byPoints_3)
byStartPointEndPoint_2 = Line.ByStartPointEndPoint(startPoint=center_3, endPoint=flatten)
length = Curve.Length(curve=byStartPointEndPoint_2)
average = Math.Average(numbers=length)
minimumItem = List.MinimumItem(list=length)
code_block_6 = CodeBlock(a=average, b=minimumItem) { a-b; }
code_block_7 = CodeBlock(length=code_block_6) { length/4; }
fillet = PolyCurve.Fillet(polyCurve=byPoints_2, radius=code_block_7)
if_ = If(test=code_block_5, true=fillet, false=byPoints_2)
code_block_8 = CodeBlock(InitialPolycurve=if_) { InitialPolycurve; }
deconstructPolyCurve_2 = Geometry.Curves.DeconstructPolyCurve(polycurve=code_block_8)
Segments_2 = Output(deconstructPolyCurve_2.Segments)  # "Segments"
code_block_9 = CodeBlock(SitePolyCurve=code_block_8) { SitePolyCurve; }
height1 = Input(height1: var[]..[])
code_block_10 = CodeBlock(height1=height1) { height1; }
translate_6 = Geometry.Translate(geometry=code_block_9, zTranslation=code_block_10)
code_block_11 = CodeBlock { 20; }
offset_2 = Curve.Offset(curve=translate_6, distance=code_block_11)
byGeometry_2 = BoundingBox.ByGeometry(geom=offset_2)
code_block_12 = CodeBlock(PTH=elevation, TTH=code_block_10) { PTH+TTH; }
ꟿ_boundingbox_2drectangle_2 = Custom[ꟿ BoundingBox.2dRectangle](boundingBox=byGeometry_2, elevation=code_block_12)
byPoints_4 = Polygon.ByPoints(points=deconstructPolyCurve_2.Points)
code_block_13 = CodeBlock(SitePolygon=byPoints_4) { SitePolygon; }
translate_7 = Geometry.Translate(geometry=code_block_13, zTranslation=code_block_10)
center_4 = Polygon.Center(polygon=translate_7)
ZAxis_3 = Vector.ZAxis()
degrees_2 = Input(degrees: double)
rotate_3 = Geometry.Rotate(geometry=ꟿ_boundingbox_2drectangle_2, origin=center_4, axis=ZAxis_3, degrees=degrees_2)
Number_2 = Input(Number: double)
divideCurve_2 = Geometry.Curves.DivideCurve(curve=rotate_3, Number=Number_2)
Planes_2 = Output(divideCurve_2.Planes)  # "Planes"
Tangents_2 = Output(divideCurve_2.Tangents)  # "Tangents"
Parameters_2 = Output(divideCurve_2.Parameters)  # "Parameters"
ZAxis_4 = Vector.ZAxis()
rotate_4 = Geometry.Rotate(geometry=translate_7, origin=center_4, axis=ZAxis_4, degrees=degrees_2)
center_5 = Polygon.Center(polygon=rotate_4)
code_block_14 = CodeBlock(a=divideCurve_2.Points) { a; }
uniqueItems_2 = List.UniqueItems(list=code_block_14)
byStartPointEndPoint_3 = Line.ByStartPointEndPoint(startPoint=center_5, endPoint=uniqueItems_2)
param_2 = Input(param: double)
pointAtParameter_2 = Curve.PointAtParameter(curve=byStartPointEndPoint_3, param=param_2)
code_block_15 = CodeBlock { 1; }
chop_2 = List.Chop(list=pointAtParameter_2, lengths=code_block_15)
lists_2 = Output(chop_2)  # "lists"
byPoints_5 = Polygon.ByPoints(points=pointAtParameter_2)
byPatch_2 = Surface.ByPatch(closedCurve=byPoints_5)
byPatch_3 = Surface.ByPatch(closedCurve=if_)
code_block_16 = CodeBlock(InitialSurface=byPatch_3) { InitialSurface; }
code_block_17 = CodeBlock(SiteSurface=code_block_16) { SiteSurface; }
translate_8 = Geometry.Translate(geometry=code_block_17, zTranslation=code_block_10)
intersect_2 = Geometry.Intersect(geometry=byPatch_2, other=translate_8)
deconstructSurface_2 = Geometry.Surfaces.DeconstructSurface(surface=intersect_2)
Edges_2 = Output(deconstructSurface_2.Edges)  # "Edges"
code_block_18 = CodeBlock { true; }
byPoints_6 = PolyCurve.ByPoints(points=deconstructSurface_2.Points, connectLastToFirst=code_block_18)
deconstructPolyCurve_3 = Geometry.Curves.DeconstructPolyCurve(polycurve=byPoints_6)
Segments_3 = Output(deconstructPolyCurve_3.Segments)  # "Segments"
code_block_19 = CodeBlock(chamferl=b) { chamferl; }
code_block_20 = CodeBlock(chamferl=code_block_19) { chamferl; }
code_block_21 = CodeBlock(b=code_block_20) { b==true; }
flatten_2 = List.Flatten(list=deconstructPolyCurve_3.Points)
byPoints_7 = Polygon.ByPoints(points=flatten_2)
center_6 = Polygon.Center(polygon=byPoints_7)
byStartPointEndPoint_4 = Line.ByStartPointEndPoint(startPoint=center_6, endPoint=flatten_2)
length_2 = Curve.Length(curve=byStartPointEndPoint_4)
average_2 = Math.Average(numbers=length_2)
minimumItem_2 = List.MinimumItem(list=length_2)
code_block_22 = CodeBlock(a=average_2, b=minimumItem_2) { a-b; }
code_block_23 = CodeBlock(length=code_block_22) { length/4; }
fillet_2 = PolyCurve.Fillet(polyCurve=byPoints_6, radius=code_block_23)
if_2 = If(test=code_block_21, true=fillet_2, false=byPoints_6)
byPatch_4 = Surface.ByPatch(closedCurve=if_2@L1)
code_block_24 = CodeBlock(TopSurface1=byPatch_4) { TopSurface1[0]; }
TopSurface = Output(code_block_24)
code_block_25 = CodeBlock(FirstPolyCurve=code_block_9) { FirstPolyCurve[0]; }
byPatch_5 = Surface.ByPatch(closedCurve=code_block_25)
code_block_26 = CodeBlock(BottomSurface1=byPatch_5) { BottomSurface1; }
BottomSurface = Output(code_block_26)
code_block_27 = CodeBlock(InitialPolycurve=if_2) { InitialPolycurve[0][0]; }
code_block_28 = CodeBlock(a=code_block_25, b=code_block_27) { [a,b]; }
byLoft = Solid.ByLoft(crossSections=code_block_28)
code_block_29 = CodeBlock(TowerSolid=byLoft) { TowerSolid; }
TowerSolid = Output(code_block_29)
